# Grasshopper definition Nautilus.gh (Grasshopper 1.0.7)

# Z
_0_to_1_00 = Slider(0, range=0..1)
_1_to_100 = Slider(0, range=0..100)
read_file = ReadFile(File="C:\Users\Zac\Desktop\Nautilus.py", PerLineParse=False)
ghpython_script = GhPythonScript(
    Code=read_file,
    NautilusSize=Slider(2, range=0..5),
    PiceSize=Slider(0.5, range=0..0.5),
    PiceNumber=Slider(60, range=0..100),
    Sharpness=Slider(0.1, range=0..0.1),
    CircleSize=Slider(2, range=0..30),
    CircleRotation=Slider(0.5, range=0..1))  # -> Out, Circles, Objects, Colours
custom_preview = CustomPreview(Geometry=ghpython_script.Objects, Material=ghpython_script.Colours)
panel = Panel(ghpython_script.Out)

read_file_2 = ReadFile(File="C:\Users\Zac\Desktop\Nautilus.py", PerLineParse=False)
ghpython_script_2 = GhPythonScript(
    Code=read_file_2,
    NautilusSize=Slider(1.875, range=0..5),
    PiceSize=Slider(0.5, range=0..0.5),
    PiceNumber=Slider(54, range=0..100),
    Sharpness=Slider(0.096, range=0..0.1),
    CircleSize=Slider(2.069, range=0..30),
    CircleRotation=Slider(0.46, range=0..1))  # -> Out, Circles, Nautilus, Colours, Temp
panel_2 = Panel(ghpython_script_2.Out)
custom_preview_2 = CustomPreview(Geometry=ghpython_script_2.Nautilus, Material=ghpython_script_2.Colours)
