# Grasshopper definition Mandelbrot.gh (Grasshopper 1.0.7)
# plug-ins: Snake, Kangaroo2 Components

read_file = ReadFile(File="C:\Zac\19 Github\Notes\MASdfab-Week3-4\Mandelbrot.py", PerLineParse=False)
snake = Snake()  # -> Snake, Food
ghpython_script = GhPythonScript(Code=read_file)  # -> Out, OutTemp
geometry = Geometry([Point(-100, 0, -12.5), Point(-87.5, -50, 25), Point(-87.5, -37.5, 12.5), Point(-87.5, -37.5, 25), Point(-87.5, -12.5, -25), Point(-87.5, 0, -25)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])
read_file_2 = ReadFile(File="C:\Zac\19 Github\Notes\MASdfab-Week3-4\MarchingCubes.py", PerLineParse=False)
panel = Panel(ghpython_script.OutTemp)
ghpython_script_2 = GhPythonScript(Code=read_file_2)  # -> Out, OutTemp
diagonalize = Diagonalize()
