# Grasshopper definition Mola.gh (Grasshopper 1.0.7)

# Z
panel = Panel("C:\Users\Zac\Desktop")
_0_to_1_00 = Slider(0, range=0..1)
_1_to_100 = Slider(0, range=0..100)
c_script = CSharpScript()  # -> Out, A
read_file = ReadFile(File="C:\Zac\19 Github\Notes\MASdfab-Week3-4\Mola.py", PerLineParse=False)
ghpython_script = GhPythonScript(Code=read_file)  # -> Out, A
